# Grasshopper definition ad_shading-typologies_example.gh (Grasshopper 1.0.7)
# plug-ins: Hops

brep = Brep([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])
bois = ColourSwatch(SwatchColor=RGB(143, 134, 117))
concat = Concatenate(FragmentA="http://compute.echoes.paris/", FragmentB="ad_shading-T1.gh")
hops = Hops(
    _Path=concat,
    _Enabled=Toggle(True),
    Façade=brep,
    Rotation=Slider(-30, range=-90..90),
    Distance=Slider(0.6, range=0.1..1.1),
    Inclination=Slider(6, range=-45..45),
    Width=Slider(0.2, range=0.1..0.3),
    CacheResultsInMemory=False,
    CacheSolveResults=False,
    RemoteDefinitionLocation="http://compute.echoes.paris/ad_shading-T1.gh",
    RemoteSolveVersion=(0, 1, 0),
    ShowInput_Enabled=True,
    ShowInput_Path=True,
    SynchronousSolve=False)  # -> Crv, V
extr = Extrude(Base=hops.Crv, Direction=hops.V)
preview = CustomPreview(Geometry=extr, Material=bois)
