# Grasshopper definition ee_surface temperature_example.gh (Grasshopper 1.0.7)
# plug-ins: Wombat, Heteroptera, Human, Weaverbird, Hops, froGH

hops = Hops(
    GetString="key_echoes",
    CacheResultsInMemory=True,
    CacheSolveResults=True,
    RemoteDefinitionLocation="C:\Users\SP\OneDrive - ECHOES\secrets.gh",
    RemoteSolveVersion=(0, 1, 0),
    ShowInput_Enabled=False,
    ShowInput_Path=False,
    SynchronousSolve=True)
your_key = Panel(hops)
unit_warning = UnitWarning(UnitSystem=4)

# ---- group: load db from ICETool repo
panel = Panel("https://raw.githubusercontent.com/Art-Ev/ICEtool/main/Scripts/Example/Step_1/Material_database.csv")
c_script = CSharpScript(url=panel)  # -> A; inputs url: String
# ---------- c_script: C# ----------
    System.Net.WebClient client = new System.Net.WebClient();
    A = client.DownloadString(url);
# ---------- end c_script ----------
c_script_2 = CSharpScript(str=c_script)  # -> out, A; inputs str: String
# ---------- c_script_2: C# ----------
A = str.Split(new string[] { Environment.NewLine }, StringSplitOptions.RemoveEmptyEntries);
# ---------- end c_script_2 ----------
tmatch = MatchText(Text=c_script_2.A, RegEx="FX", Case=True)
cull = CullPattern(List=c_script_2.A, CullPattern=invert(tmatch))
split = TextSplit(Text=cull, Separators=";")  # -> simplify(Result)
path = ConstructPath(Indices="0")
split_2 = SplitTree(Data=split, Masks=flatten(path))  # -> Positive, Negative
panel_2 = Panel("""alb
em
Cv
lambd
ep
kc
ID""")
mindex = MemberIndex(Set=split_2.Positive, Member=panel_2)  # -> Index, Count
item = ListItem(List=split, Index=flatten(mindex.Index), Wrap=True)
join = TextJoin(Text=item, Join=",")  # -> flatten(Result)

# ----
f_ghfilepath = GHFilePathInfo()  # -> FileName, FilePath
concat = Concatenate(FragmentA=f_ghfilepath.FilePath, FragmentB="ee_surface temperature_example.3dm")
_3dm = Read3dmFile(FilePath=concat, LayerFilter="*")  # -> Objects, LayerNames, Attributes, Units
panel_3 = Panel("""trees
materials::""")
tmatch_2 = MatchText(Text=_3dm.LayerNames, RegEx=graft(panel_3), Case=True)
cull_2 = CullPattern(List=_3dm.Objects, CullPattern=tmatch_2)  # -> simplify(List)
cull_3 = CullPattern(List=_3dm.LayerNames, CullPattern=tmatch_2)  # -> simplify(List)
bang = ExplodeTree(Data=cull_2)  # -> Branch0, Branch1
bang_2 = ExplodeTree(Data=cull_3)  # -> Branch0, Branch1
split_3 = TextSplit(Text=bang_2.Branch1, Separators=":")
item_2 = ListItem(List=reverse(split_3), Index=0, Wrap=True)  # -> flatten(Item)
Z = UnitZ(Factor="6")
division = Division(A="6", B=1.5)
move = Move(Geometry=bang.Branch0, Motion=Z)  # -> Geometry, Transform
msphere = MeshSphere(Base=move.Geometry, Radius=division, UCount="6", VCount="6")
list = ValueList({".5", "1", "2", "3", "5", "10"}, selected="5")
custom_mesh_settings = SettingsCustom(
    StitchSeams=True,
    SimplePlanes=False,
    Refine="0",
    MinCount=16,
    MaxCount=100,
    AspectRatio=20,
    MaxDistance=0,
    MaxAngle=20,
    MinEdge=expr("x/1.1", list),
    MaxEdge=expr("x*1.1", list))
geo = Geometry(bang.Branch1)
clean = CleanTree(RemoveNulls=True, RemoveInvalid=True, RemoveEmpty=True, Tree=geo)  # -> flatten(Tree)

wires = BrepWireframe(Brep=geo, Density=-1)
wbedges = WeaverbirdsMeshEdges(MeshOrPolylines=msphere)
black = ColourSwatch(SwatchColor=RGB(0, 0, 0))
previewlw = CustomPreviewLineweights(Geometry=[wires, wbedges], Shader=black, Absolute=False)

mesh = MeshBrep(Brep=clean, Settings=custom_mesh_settings)
mjoin = MeshJoin(Meshes=flatten(msphere))
panel_4 = Panel("https://energyplus-weather.s3.amazonaws.com/europe_wmo_region_6/FRA/FRA_Paris.Orly.071490_IWEC/FRA_Paris.Orly.071490_IWEC.zip")
geometry = Mesh(mesh)
materials = Text(item_2)
matdb = Text(join)
context = Mesh(mjoin)
hops_2 = Hops(
    _Path="https://compute.echoes.paris/ee_Surface-Temperature.gh",
    _Enabled=Toggle(False),
    Key=your_key,
    MaterialData=matdb,
    Geometry=geometry,
    Materials=materials,
    Context=context,
    Month="7",
    Day="21",
    EpwURL=panel_4,
    CacheResultsInMemory=True,
    CacheSolveResults=True,
    RemoteDefinitionLocation="https://compute.echoes.paris/ee_Surface-Temperature.gh",
    RemoteSolveVersion=(0, 1, 0),
    ShowInput_Enabled=True,
    ShowInput_Path=True,
    SynchronousSolve=False)  # -> Readme, Mesh, TC

h = Slider(15, range=0..23)
list_2 = ValueList({"daily min": 0, "daily max": 1, "daily average": 2, "hourly data": 3}, selected="hourly data")

num = Number(hops_2.TC)
colrange = LBColorRange(index=Slider(0, range=0..25))  # -> colors; plug-in component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
bnd = Bounds(Numbers=flatten(num))
extremums = MinMax(Number=num)  # -> flatten(Minimum), flatten(Maximum)
avr = Average(Input=num)  # -> flatten(ArithmeticMean)
item_3 = ListItem(List=num, Index=h, Wrap=False)  # -> flatten(Item)
concat_2 = Concatenate(FragmentA=h, FragmentB="h")
dedomain = DeconstructDomain(Domain=bnd)  # -> Start, End
entwine = Entwine(Branch00=extremums.Minimum, Branch01=extremums.Maximum, Branch02=avr, Branch03=item_3, FlattenInputs=True)  # -> simplify(Result)
bnd_2 = Bounds(Numbers=flatten(item_3))
legendpar = LBLegendParameters(
    min=dedomain.Start,
    max=dedomain.End,
    seg_count="11",
    colors=colrange,
    continuous_leg="0",
    num_decimals="0",
    larger_smaller="0",
    vert_or_horiz="0")  # -> leg_par; plug-in component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
panel_5 = Panel(bnd)
branch = TreeBranch(Tree=entwine, Path=list_2, MaintainPaths=True)
panel_6 = Panel(bnd_2)
heatmap = LBSpatialHeatmap(values=branch, mesh=hops_2.Mesh, legend_par=legendpar, legend_title=concat_2)  # -> mesh, legend, title, colors, legend_par; plug-in component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
mesh_2 = Mesh(heatmap.mesh)
